% Simulink data dictionary DD_SOC_Estimation_old.sldd
% references Shared_DD.sldd

SOCInit = 0.75
Ts = 0.1
Variant = Simulink.VariantConfigurationData()
BMS_Sw_CodeGenConfigc = Simulink.ConfigSet(StartTime="0", StopTime="10", RelTol="1e-3", Solver="VariableStepAuto", ProdHWDeviceType="Intel->x86-64 (Windows64)", SystemTargetFile="grt.tlc", TargetLang="C")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