% Simulink data dictionary DD_State_Machine.sldd
% references DD_CurrPowerLimCalc.sldd
% references Shared_DD.sldd

CV_Gain = single(0.2)
LowTempLimit = single(278.15)
MaxCellVoltThrsld = single(4.2)
SnsrFltThld = 0.252
I_cc = single(30)

Contact = enum(DefaultValue="Open", StorageType="int8")
  Init = 0
  Open = 1
  Close = 2

contactorTime = uint16(200)
timeoutContactor = uint8(1)
vRatio = single(0.95)
voltThreshold = single(4.1)
currentFactor = single(10)
noCurrent = single(0)
HighTempLimit = single(323.15)
timeoutCurrent = uint8(2)