% Requirement links of State_Machine.slx (R2019a)

model implements BMS_Requirements.slreqx#26: 3.1.1 BMS Main State Machine: Interfaces: BMS Main State Machine: Interfaces
model implements BMS_Requirements.slreqx#27: 3.1.1.1 Inputs: Inputs
model implements BMS_Requirements.slreqx#28: 3.1.1.2 Outputs: Outputs
model implements BMS_Requirements.slreqx#25: 3.1 BMS - Main State Machine: BMS - Main State Machine
model implements StateMachine_Requirements.slreqx#7: Inputs
model implements StateMachine_Requirements.slreqx#18: Outputs
block :1 implements StateMachine_Requirements.slreqx#9: Cell_Voltages
block :12 implements StateMachine_Requirements.slreqx#20: BMS_State
block :13 implements StateMachine_Requirements.slreqx#21: ChargeCurrentReq
block :14 implements StateMachine_Requirements.slreqx#22: PosContactorChgrCmd
block :15 implements StateMachine_Requirements.slreqx#23: PreChargeRelayChgrCmd
block :16 implements StateMachine_Requirements.slreqx#24: NegContactorChgrCmd
block :17 implements StateMachine_Requirements.slreqx#25: PosContactorInvtrCmd
block :18 implements StateMachine_Requirements.slreqx#26: PreChargeRelayInvtrCmd
block :19 implements StateMachine_Requirements.slreqx#27: NegContactorInvtrCmd
block :2 implements StateMachine_Requirements.slreqx#11: Pack_Voltage
block :22 implements StateMachine_Requirements.slreqx#17: MinCellVolt
block :23 implements StateMachine_Requirements.slreqx#15: Current_Limits
block :24 implements StateMachine_Requirements.slreqx#12: Pack_Current
block :3 implements StateMachine_Requirements.slreqx#10: Cell_Temperatures
block :36 implements StateMachine_Requirements.slreqx#28: Faults
block :4 implements StateMachine_Requirements.slreqx#13: Vout_Chgr
block :5 implements StateMachine_Requirements.slreqx#14: Vout_Invrt
block :6 implements StateMachine_Requirements.slreqx#16: MaxCellVolt
block :7 implements StateMachine_Requirements.slreqx#8: StateRequest
block :8 implements StateMachine_Requirements.slreqx#29: Overview
block :8:415 implements BMS_Requirements.slreqx#30: 3.1.3 BMS Main State Machine: Charging Mode calculation: BMS Main State Machine: Charging Mode calculation
block :8:415 implements StateMachine_Requirements.slreqx#52: BMS State in Charging  % Just changed indentations
block :8:415 implements StateMachine_Requirements.slreqx#53: Exit Conditions and Priorities  % Just changed indentations  % Just changed indentations
block :8:415 implements StateMachine_Requirements.slreqx#58: Charge Mode and Charge Current Request Calculation  % Just changed indentations
block :8:416 implements StateMachine_Requirements.slreqx#61: CC Charge Mode  % Just changed indentations
block :8:416 implements StateMachine_Requirements.slreqx#73: Exit Condition and Priorities
block :8:417 implements StateMachine_Requirements.slreqx#64: Exit to Charge CC  % Just changed indentations
block :8:418 implements StateMachine_Requirements.slreqx#62: CV Charge Mode  % Just changed indentations
block :8:419 implements StateMachine_Requirements.slreqx#60: Init Charge Mode  % Just changed indentations
block :8:420 implements StateMachine_Requirements.slreqx#63: Exit to Charge Init  % Just changed indentations
block :8:421 implements StateMachine_Requirements.slreqx#59: Enter in Charging State  % Just changed indentations
block :8:422 implements StateMachine_Requirements.slreqx#74: Exit to Charge CC  % Just changed indentations
block :8:423 implements StateMachine_Requirements.slreqx#68: Exit to Charge Init  % Just changed indentations
block :8:471 implements StateMachine_Requirements.slreqx#39: BMS State in Driving  % Just changed indentations
block :8:471 implements StateMachine_Requirements.slreqx#51: Exit Conditions and Priorities
block :8:472 implements StateMachine_Requirements.slreqx#32: BMS State in Standby  % Just changed indentations
block :8:472 implements StateMachine_Requirements.slreqx#45: Exit Conditions and Priorities
block :8:473 implements StateMachine_Requirements.slreqx#48: Initial BMS Mode  % Just changed indentations
block :8:477 implements StateMachine_Requirements.slreqx#33: Exit conditions to BMS State Charging  % Just changed indentations  % Just changed indentations
block :8:478 implements StateMachine_Requirements.slreqx#55: Exit conditions to BMS State Driving  % Just changed indentations  % Just changed indentations
block :8:483 implements StateMachine_Requirements.slreqx#34: Exit conditions to BMS State Driving  % Just changed indentations  % Just changed indentations
block :8:484 implements StateMachine_Requirements.slreqx#41: Exit conditions to BMS State Charging  % Just changed indentations  % Just changed indentations
block :8:485 implements BMS_Requirements.slreqx#29: 3.1.2 BMS Main State Machine: BMS State calculation: BMS Main State Machine: BMS State calculation
block :8:485 implements StateMachine_Requirements.slreqx#31: BMS State and Charging Mode calculation
block :8:501 implements BMS_Requirements.slreqx#31: 3.1.4 BMS Main State Machine: Relay Charger Commands: BMS Main State Machine: Relay Charger Commands
block :8:501 implements StateMachine_Requirements.slreqx#112: Charger Contactors Management
block :8:505 implements StateMachine_Requirements.slreqx#113: Opening
block :8:538 implements BMS_Requirements.slreqx#32: 3.1.5 BMS Main State Machine: Relay Inverter Commands: BMS Main State Machine: Relay Inverter Commands
block :8:576 implements StateMachine_Requirements.slreqx#57: BMS State in Fault  % Just changed indentations
block :8:578 implements StateMachine_Requirements.slreqx#36: Exit conditions to BMS State Fault  % Just changed indentations  % Just changed indentations
block :8:579 implements StateMachine_Requirements.slreqx#42: Exit conditions to BMS State Fault  % Just changed indentations  % Just changed indentations
block :8:583 implements StateMachine_Requirements.slreqx#54: Exit conditions to BMS State Fault  % Just changed indentations  % Just changed indentations
block :8:585 implements BMS_Requirements.slreqx#33: 3.1.6 BMS Main State Machine: Fault Monitor Calculation: BMS Main State Machine: Fault Monitor Calculation
block :8:585 implements StateMachine_Requirements.slreqx#76: BMS Fault Monitoring
block :8:586 implements StateMachine_Requirements.slreqx#101: Low Tempearture Fault
block :8:587 implements BMS_Requirements.slreqx#35: 3.1.6.2 Temperature Limitation: Temperature Limitation
block :8:587 implements StateMachine_Requirements.slreqx#89: Temperature Fault
block :8:588 implements StateMachine_Requirements.slreqx#100: Exit to Low Tempearture Fault
block :8:590 implements StateMachine_Requirements.slreqx#99: Exit to High Tempearture Fault
block :8:591 implements StateMachine_Requirements.slreqx#93: High Tempearture Fault
block :8:592 implements StateMachine_Requirements.slreqx#90: Init State
block :8:593 implements StateMachine_Requirements.slreqx#91: No Temperature Fault State
block :8:593 implements StateMachine_Requirements.slreqx#98: Exit Condition and Priorities
block :8:597 implements StateMachine_Requirements.slreqx#107: Exit to Under Voltage Fault
block :8:598 implements StateMachine_Requirements.slreqx#103: Init State
block :8:599 implements StateMachine_Requirements.slreqx#108: Over Voltage Fault
block :8:600 implements StateMachine_Requirements.slreqx#106: Exit to Over Voltage Fault
block :8:601 implements StateMachine_Requirements.slreqx#109: Under Voltage Fault
block :8:602 implements StateMachine_Requirements.slreqx#104: No Voltage Fault State
block :8:602 implements StateMachine_Requirements.slreqx#105: Exit Condition and Priorities
block :8:603 implements BMS_Requirements.slreqx#36: 3.1.6.3 Voltage Limitation: Voltage Limitation
block :8:603 implements StateMachine_Requirements.slreqx#102: Voltage Fault
block :8:610 implements StateMachine_Requirements.slreqx#111: Sensor Fault
block :8:611 implements StateMachine_Requirements.slreqx#110: Exit to Sensor Fault
block :8:618 implements StateMachine_Requirements.slreqx#78: Init State
block :8:620 implements StateMachine_Requirements.slreqx#88: Over Current Limitation
block :8:622 implements StateMachine_Requirements.slreqx#79: No Current Limitation State
block :8:625 implements BMS_Requirements.slreqx#34: 3.1.6.1 Current Limitation: Current Limitation
block :8:625 implements StateMachine_Requirements.slreqx#77: Current Limitation
block :8:630 implements StateMachine_Requirements.slreqx#40: Exit conditions to BMS State Standby  % Just changed indentations  % Just changed indentations
block :8:631 implements StateMachine_Requirements.slreqx#56: Exit conditions to BMS State Standby  % Just changed indentations  % Just changed indentations
block :8:632 implements StateMachine_Requirements.slreqx#87: Wait State
block :8:632 implements StateMachine_Requirements.slreqx#81: Exit Condition and Priorities
block :8:633 implements StateMachine_Requirements.slreqx#80: Exit to Wait State
block :8:634 implements StateMachine_Requirements.slreqx#83: Exit to No Current Limitation