% Requirement links of State_Machine_Test.mldatx (R2019a)

item 1 verifies StateMachine_Requirements.slreqx#52: BMS State in Charging
item 2 verifies StateMachine_Requirements.slreqx#111: Sensor Fault
item 3 verifies StateMachine_Requirements.slreqx#93: High Tempearture Fault
item 4 verifies StateMachine_Requirements.slreqx#80: Exit to Wait State
item 5 verifies StateMachine_Requirements.slreqx#109: Under Voltage Fault
item 6 verifies StateMachine_Requirements.slreqx#108: Over Voltage Fault
item 7 verifies StateMachine_Requirements.slreqx#80: Exit to Wait State