# Requirement set BMS_Requirements (R2019a)

## 1 [BMS_Requirements] References to BMS_Requirements.docx (Container)
Read-only references to Microsoft Word document.
Comment: There are no changes
Comment: Deleted: 3.3.4 BMS Current Limit Calculation: SOC EKF
Deleted: 3.4.3 BMS Balancing Logic: Contacts Co
Comment: There are no changes
Comment: Inserted: 3.3.2 BMS Current Limit Calculation: Coulomb Counting
Inserted: 3.3.3 BMS Current Limit Calculation: SOC UKF
Inserted: 3.3.4 BMS Current Limit Calculation: SOC EKF
Inserted: 3.4.2 BMS Balancing Logic: Balancing ON/OFF
Inserted: 3.4.3 BMS Balancing Logic: Contacts Co
Comment: Inserted: 3.2.2 BMS Current Limit Calculation: Min/Max Calculation
Inserted: 3.2.3 BMS Current Limit Calculation: D
Updated: 3.2.4 BMS Current Limit Calculation: C. Properties: description
Updated: 3.4.2 BMS Balancing Logic: Balancing ON/OFF. Properties: description
Updated: 3.4.3 BMS Balancing Logic: Contacts Co. Properties: description
Comment: Deleted: 2.2.1 SOC
Deleted: 2.2.10 PreChargeRelayInvtrCmd
Deleted: 2.2.11 NegContactorInvtrCmd
Deleted: 2.2.2 BMS_State
Deleted: 2.2.3 Current Limits
Deleted: 2.2.4 BalCmd
Deleted: 2.2.5 ChargeCurrentReq
Deleted: 2.2.6 PosContactorChgrCmd
Deleted: 2.2.7 PreChargeRelayChgrCmd
Deleted: 2.2.8 NegContactorChgrCmd
Deleted: 2.2.9 PosContactorInvtrCmd
Updated: 3 BMS Architecture and module specifications. Properties: description
Updated: 3.1 BMS - Main State Machine. Properties: description
Updated: 3.1.5 BMS Main State Machine: Relay Inverter Commands. Properties: description
Updated: 3.1.6.3 Voltage Limitation. Properties: description
Updated: 3.2 BMS – Current Limit Calculation. Properties: description
Updated: 3.2.2 BMS Current Limit Calculation: Min/Max Calculation. Properties: description
Updated: 3.2.3 BMS Current Limit Calculation: D. Properties: description
Updated: 3.2.4 BMS Current Limit Calculation: C. Properties: description
Updated: 3.3 BMS – SOC Estimation. Properties: description
Deleted: 3.3.2 BMS Current Limit Calculation: Coulomb Counting
Inserted: 3.3.2 BMS SOC Estimation: Coulomb Counting
Deleted: 3.3.3 BMS Current Limit Calculation: SOC UKF
Inserted: 3.3.3 BMS SOC Estimation: SOC UKF
Deleted: 3.3.4 BMS Current Limit Calculation: SOC EKF
Inserted: 3.3.4 BMS SOC Estimation: SOC EKF
Updated: 3.4 BMS – Balancing Logic. Properties: description
Updated: 3.4.2 BMS Balancing Logic: Balancing ON/OFF. Properties: description
Updated: 3.4.3 BMS Balancing Logic: Contacts Co. Properties: description
Comment: There are no changes
Comment: There are no changes

### 1.1 [1 Overview]
This document describes a requirement specification for Battery Management System (BMS). The BMS system provides functionalities to control the battery pack.

### 1.2 [2 BMS Interfaces]

#### 1.2.1 [2.1 BMS Inputs]
| Name | Data type | Units | From |
| StateRequest | enum | / | CAN |
| Cell_Voltages | single | V | Sensors |
| Cell_Temperatures | single | K | Sensors |
| Pack_Voltage | single | V | Sensors |
| Pack_Current | single | A | Sensors |
| Vout_Chgr | single | V | Sensors |
| Vout_Invtr | single | V | Sensors |

##### 1.2.1.1 [2.1.1 Cell_Voltages]
BMS shall measure voltage across each cell block (cells in series) at sample rate of 10Hz.

##### 1.2.1.2 [2.1.2 Cell_Temperatures]
BMS shall measure battery cell Temperatures (Cell_Temperatures)

##### 1.2.1.3 [2.1.3 Pack_Current]
BMS shall measure current flowing through battery pack at sample rate of 10Hz. Pack_Current > 0 indicates battery pack charging. Pack_Current < 0 indicates battery pack discharging.

##### 1.2.1.4 [2.1.4 Pack_Voltage]
BMS shall measure voltage across Pack terminals (+Ve Batt and -Ve Batt) at sample rate of 10Hz.

##### 1.2.1.5 [2.1.5 Vout_Chgr]
BMS shall measure terminal voltage at charger contactor (Vout_Chgr).

##### 1.2.1.6 [2.1.6 Vout_Invtr]
BMS shall measure terminal voltage at Inverter contactor (Vout_Invtr)

##### 1.2.1.7 [2.1.7 StateRequest]
BMS shall read State Request from CAN Bus (StateRequest)

#### 1.2.2 [2.2 BMS Outputs]
| Name | Data type | Units | To |
| SOC | boolean | % | CAN |
| BMS_State | boolean | enum | CAN |
| Current Limits | single | A | Other BMS modules / Plant (DriveLoad) |
| BalCmd | boolean | / | Plant (DriveLoad) |
| ChargeCurrentReq | boolean | / | Plant (Charger) |
| PosContactorChgrCmd | boolean | / | Plant (BatteryPack CellMonitoring) |
| PreChargeRelayChgrCmd | boolean | / | Plant (BatteryPack CellMonitoring) |
| NegContactorChgrCmd | boolean | / | Plant (BatteryPack CellMonitoring) |
| PosContactorInvtrCmd | boolean | / | Plant (BatteryPack CellMonitoring) |
| PreChargeRelayInvtrCmd | boolean | / | Plant (BatteryPack CellMonitoring) |
| NegContactorInvtrCmd | boolean | / | Plant (BatteryPack CellMonitoring) |

##### 1.2.2.1 [2.2.1 SOC]
State of Charge

##### 1.2.2.2 [2.2.2 BMS_State]
(State: Standby-Charging-Discharging-Fault)

##### 1.2.2.3 [2.2.3 Current Limits]
(Limits for Charge and Discharge

##### 1.2.2.4 [2.2.4 BalCmd]
(Command to balance the battery cells)

##### 1.2.2.5 [2.2.5 ChargeCurrentReq]
(Current request during charging)

##### 1.2.2.6 [2.2.6 PosContactorChgrCmd (]
Command for contactor on the Positive pole of the charger)

##### 1.2.2.7 [2.2.7 PreChargeRelayChgrCmd]
(Command for contactor for pre-charge of the charger)

##### 1.2.2.8 [2.2.8 NegContactorChgrCmd]
(Command for contactor on the Negative pole of the charger)

##### 1.2.2.9 [2.2.9 PosContactorInvtrCmd]
(Command for contactor on the Positive pole of the inverter)

##### 1.2.2.10 [2.2.10 PreChargeRelayInvtrCmd]
(Command for contactor for pre-charge of the inverter)

##### 1.2.2.11 [2.2.11 NegContactorInvtrCmd]
Command for contactor on the Positive pole of the Inverter)

### 1.3 [3 BMS Architecture and module specifications]
BMS software must be divided in 4 modules:
1. Main State Machine
2. Current Power Limits Calculation
3. SOC Estimation
4. Balancing Logic
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
#### 1.3.1 [3.1 BMS - Main State Machine]
The Main State Machine has 4 main functionalities:
- Manage the BMS status evolution on driving requests and safety
- Calculate the correct charging mode
- Monitors current, voltage and temperature faults for safety
- Securely close and open the contacts to the charger e inverter
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
##### 1.3.1.1 [3.1.1 BMS Main State Machine: Interfaces]

###### 1.3.1.1.1 [3.1.1.1 Inputs]
| Name | Data type | Units | From |
| StateRequest | enum | / | CAN |
| Cell_Voltages | single | V | Sensors |
| Cell_Temperatures | single | K | Sensors |
| Pack_Voltage | single | V | Sensors |
| Pack_Current | single | A | Sensors |
| Vout_Chgr | single | V | Sensors |
| Vout_Invtr | single | V | Sensors |
| Current Limits | single | A | Other BMS modules |
| Max Cell Voltage | single | V | From other BMS modules |
| Min Cell Voltage | single | V | From other BMS modules |

###### 1.3.1.1.2 [3.1.1.2 Outputs]
| Name | Data type | Units | To |
| BMS_State | boolean | enum | CAN & other modules |
| ChargeCurrentReq | boolean | / | Plant (Charger) |
| PosContactorChgrCmd | boolean | / | Plant (BatteryPack CellMonitoring) |
| PreChargeRelayChgrCmd | boolean | / | Plant (BatteryPack CellMonitoring) |
| NegContactorChgrCmd | boolean | / | Plant (BatteryPack CellMonitoring) |
| PosContactorInvtrCmd | boolean | / | Plant (BatteryPack CellMonitoring) |
| PreChargeRelayInvtrCmd | boolean | / | Plant (BatteryPack CellMonitoring) |
| NegContactorInvtrCmd | boolean | / | Plant (BatteryPack CellMonitoring) |

##### 1.3.1.2 [3.1.2 BMS Main State Machine: BMS State calculation]
It is necessary to switch appropriately the BMS Mode (Standby, Charging, Driving, State) based on State Request, Relay Contactors States (charger and Inverter), Fault

##### 1.3.1.3 [3.1.3 BMS Main State Machine: Charging Mode calculation]
It is necessary to switch appropriately the Charge Mode (Init, Costant Current (CC) Mode, Costant Voltage (CV) Mode)

##### 1.3.1.4 [3.1.4 BMS Main State Machine: Relay Charger Commands]
It is necessary to open and close appropriately the Relays (Pre-charger, Positive and Negative) for the Charger

##### 1.3.1.5 [3.1.5 BMS Main State Machine: Relay Inverter Commands]
It is necessary to open and close appropriately the Relays (Pre-charger, Positive and Negative) for the Inverter

##### 1.3.1.6 [3.1.6 BMS Main State Machine: Fault Monitor Calculation]

###### 1.3.1.6.1 [3.1.6.1 Current Limitation]
It is necessary detect the Over Current Pack Fault

###### 1.3.1.6.2 [3.1.6.2 Temperature Limitation]
It is necessary detect the High and Low Cell Temperature Fault

###### 1.3.1.6.3 [3.1.6.3 Voltage Limitation]
It is necessary detect the Over and Under Voltage Temperature Fault

#### 1.3.2 [3.2 BMS – Current Limit Calculation]
The Current Limit Calculation must calculate Minimum and Maximum Cell Voltage and the Current limits
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
##### 1.3.2.1 [3.2.1 BMS Current Limit Calculation: Interfaces]

###### 1.3.2.1.1 [3.2.1.1 Inputs]
| Name | Data type | Units | Description |
| Cell_Voltages | single | V | Sensors |

###### 1.3.2.1.2 [3.2.1.2 Outputs]
| Name | Data type | Units | to |
| Current Limits | single | A | Other BMS modules / Plant (DriveLoad) |
| Max Cell Voltage | single | V | Other BMS modules |
| Min Cell Voltage | single | V | Other BMS modules |

##### 1.3.2.2 [3.2.2 BMS Current Limit Calculation: Min/Max Calculation]
Calculation of Max and Min Voltage between cells

##### 1.3.2.3 [3.2.3 BMS Current Limit Calculation: D] BMS Current Limit Calculation: Discharge Current Limit
3.2.3 BMS Current Limit Calculation: Discharge Current Limit
Calculate the discharge current limit following Software requirements

##### 1.3.2.4 [3.2.4 BMS Current Limit Calculation: C] BMS Current Limit Calculation: Charge Current Limit
3.2.4 BMS Current Limit Calculation: Charge Current Limit
Calculate the charge current limit following Software requirements

#### 1.3.3 [3.3 BMS – SOC Estimation]
The SOC Estimation must calculate SOC estimation (SOC_CC, SOC_UKF, SOC_EKF)
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
##### 1.3.3.1 [3.3.1 BMS SOC Estimation: Interfaces]

###### 1.3.3.1.1 [3.3.1.1 Inputs]
| Name | Data type | Units | From |
| Pack_Current | single | A | Sensors |
| Cell_Temperatures | single | K | Sensors |
| Cell_Voltages | single | V | Sensors |

###### 1.3.3.1.2 [3.3.1.2 Outputs]
| Name | Data type | Units | To |
| SOCs | % | / | CAN |

##### 1.3.3.2 [3.3.2 BMS SOC Estimation: Coulomb Counting]
Calculate the SOC with Coulomb Counting following Software requirements

##### 1.3.3.3 [3.3.3 BMS SOC Estimation: SOC UKF]
Calculate the SOC with UKF following Software requirements

##### 1.3.3.4 [3.3.4 BMS SOC Estimation: SOC EKF]
Calculate the SOC with EKF following Software requirements

#### 1.3.4 [3.4 BMS – Balancing Logic]
The Balancing Logic must securely close and open the contacts to the charger e inverter
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
##### 1.3.4.1 [3.4.1 BMS Balancing Logic Interfaces]

###### 1.3.4.1.1 [3.4.1.1 Inputs]
| Name | Data type | Units | From |
| BMS_State | boolean | enum | Other modules |
| Cell_Voltages | single | V | Sensors |
| Max Cell Voltage | single | V | Other BMS modules |
| Min Cell Voltage | single | V | Other BMS modules |

###### 1.3.4.1.2 [3.4.1.2 Outputs]
| Name | Data type | Units | To |
| BalCmd | boolean | / | Plant (DriveLoad) |

##### 1.3.4.2 [3.4.2 BMS Balancing Logic: Balancing ON/OFF]
Calculate if perform balancing

##### 1.3.4.3 [3.4.3 BMS Balancing Logic: Contacts Co] BMS Balancing Logic: Contacts Command calculation & Deactivation
3.4.3 BMS Balancing Logic: Contacts Command calculation & Deactivation
Calculate the commands for inverter and charger contactors