# Requirement set StateMachine_Requirements (R2019a)

## 1 [#29] Overview
The Main State Machine has 4 main functionalities:
- Manage the BMS status evolution on driving requests and safety
- Calculate the correct charging mode
- Monitors current, voltage and temperature faults for safety
- Securely close and open the contacts to the charger e inverter

## 2 [#7] Inputs

### 2.1 [#8] StateRequest
Data type: enum: SRE(Balancing = 0, Charging = 1, Driving = 2)
Unit: /
Min: 0
Max: 2

### 2.2 [#9] Cell_Voltages
Data type: single
Unit: V
Min: 0
Max 5:
Dimension: # Cells

### 2.3 [#10] Cell_Temperatures
Data type: single
Unit: K
Min: 263,15
Max:333.15
Dimension: # Cells

### 2.4 [#11] Pack_Voltage
Data type: single
Unit: V
Min: 0
Max: 480

### 2.5 [#12] Pack_Current
Data type: single
Unit: A
Min: - 100
Max: 100

### 2.6 [#13] Vout_Chgr
Data type: single
Unit: V
Min: -500
Max: 500

### 2.7 [#14] Vout_Invrt
Data type: single
Unit: V
Min: -500
Max: 500

### 2.8 [#15] Current_Limits
Data type: Bus:CurrentLimits
Unit: A
Min:
Max:

### 2.9 [#16] MaxCellVolt
Data type: single
Unit: V
Min: 0
Max: 5

### 2.10 [#17] MinCellVolt
Data type: single
Unit: V
Min: 0
Max: 5

## 3 [#18] Outputs

### 3.1 [#20] BMS_State
Data type: Enum
Unit: /
Min:
Max:

### 3.2 [#21] ChargeCurrentReq
Data type: single
Unit: A
Min: -100
Max: 100

### 3.3 [#22] PosContactorChgrCmd
Data type: bool
Unit: /
Min: 0
Max: 1

### 3.4 [#23] PreChargeRelayChgrCmd
Data type: bool
Unit: /
Min: 0
Max: 1

### 3.5 [#24] NegContactorChgrCmd
Data type: bool
Unit:
Min: 0
Max: 1

### 3.6 [#25] PosContactorInvtrCmd
Data type: bool
Unit: /
Min: 0
Max: 1

### 3.7 [#26] PreChargeRelayInvtrCmd
Data type: bool
Unit: /
Min: 0
Max: 1

### 3.8 [#27] NegContactorInvtrCmd
Data type: bool
Unit: /
Min: 0
Max: 1

### 3.9 [#28] Faults
Data type: bool
Unit: Bus
Min: 0
Max: 1

## 4 [#30] State Machine Architecture

### 4.1 [#31] BMS State and Charging Mode calculation
It is necessary to switch appropriately the BMS Mode (Standby, Charging, Driving, State) based on State Request, Relay Contactors States (charger and Inverter), Fault. Furthermore it is necessary to request appropriately the charging mode
BMS Mode can have the following Values:
- BMS_Standby
- BMS_Driving
- BMS_Charging
- BMS_Fault
The initial BMS Mode is BMS_Standby
Charging Mode can have the following Values:
- CC Mode (Constant Current)
- CV Mode (Constant Voltage)
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
#### 4.1.1 [#48] Initial BMS Mode
The initial BMS Mode is BMS_Standby

#### 4.1.2 [#32] BMS State in Standby
When in Standby State the BMS_State is = BMS_Standby

##### 4.1.2.1 [#45] Exit Conditions and Priorities
Priory Exits:
- to Fault
- to Charging
- to Driving

###### 4.1.2.1.1 [#33] Exit conditions to BMS State Charging
if State Request is Charging and Charging contactors are closed

###### 4.1.2.1.2 [#34] Exit conditions to BMS State Driving
if State Request is Driving and Inverter contactors are closed

###### 4.1.2.1.3 [#36] Exit conditions to BMS State Fault
if Fault is present

#### 4.1.3 [#39] BMS State in Driving
When in Standby State the BMS_State is = BMS_Driving

##### 4.1.3.1 [#51] Exit Conditions and Priorities
Priory Exits:
- to Fault
- to Charging
- to Standby

###### 4.1.3.1.1 [#40] Exit conditions to BMS State Standby
if State Request is different from Driving and Inverter contactors are init

###### 4.1.3.1.2 [#41] Exit conditions to BMS State Charging
if State Request is Charging and Charger contactors are closed

###### 4.1.3.1.3 [#42] Exit conditions to BMS State Fault
if Fault is present

#### 4.1.4 [#52] BMS State in Charging
When in Standby State the BMS_State is = BMS_Charging

##### 4.1.4.1 [#53] Exit Conditions and Priorities
Priory Exits:
1) to Fault
2) to Driving
3) to Standby

###### 4.1.4.1.1 [#54] Exit conditions to BMS State Fault
if Fault is present

###### 4.1.4.1.2 [#55] Exit conditions to BMS State Driving
if State Request is Charging and Inverter contactors are Closed

###### 4.1.4.1.3 [#56] Exit conditions to BMS State Standby
if State Request is diffrenet from Charging and Charging contactors are Init

##### 4.1.4.2 [#58] Charge Mode and Charge Current Request Calculation
In Charging State there are 3 Charge mode states:
- Init
- CC (Constant Current)
- CV (Constant Voltage)

###### 4.1.4.2.1 [#59] Enter in Charging State
Once enter in Charging state the initial Charge Mode is Init

###### 4.1.4.2.2 [#60] Init Charge Mode
When in Init Charge Mode:
ChargeModeReq = No_Charging and
ChargeCurrentRequest = 0

###### 4.1.4.2.2.1 [#64] Exit to Charge CC
if State Request is Charging and MaxCellVolt < Charging_CC_Threshold

###### 4.1.4.2.3 [#61] CC Charge Mode
When in Init Charge Mode:
ChargeModeReq = CC_Charging and
ChargeCurrentRequest(z) = min(Icc, ChargeCurrentLimit)

###### 4.1.4.2.3.1 [#73] Exit Condition and Priorities
Priory Exits:
1) Exit to Charge Init Mode
2) Exit to Charge CC Mode

###### 4.1.4.2.3.1.1 [#63] Exit to Charge Init
if State Request is different from Charging

###### 4.1.4.2.3.1.2 [#74] Exit to Charge CC
if State Request is Charging and MaxCellVolt >= MaxCellVoltThrsld

###### 4.1.4.2.4 [#62] CV Charge Mode
When in Init Charge Mode:
ChargeModeReq = CV_Charging and
ChargeCurrentRequest(z) = min((ChargeCurrentReq(z-1) - CV_Gain*(MaxCellVolt - MaxCellVoltThrsld), ChargeCurrentLimit);

###### 4.1.4.2.4.1 [#68] Exit to Charge Init
if State Request is different from Charging OR ChargeCurrentReq <= Icc/10

#### 4.1.5 [#57] BMS State in Fault
When in Fault State the BMS_State is = BMS_Fault

### 4.2 [#76] BMS Fault Monitoring
It is necessary monitoring and limitate:
- Current
- Temperature
- Voltage
in the battery
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
#### 4.2.1 [#77] Current Limitation
During Current monitoring there are 3 states:
- No Current Limitation
- Wait
- Over Current Fault

##### 4.2.1.1 [#78] Init State
The initial state is No Current Limitation.
Before to enter in this state we set FaultPresent = false

##### 4.2.1.2 [#79] No Current Limitation State

###### 4.2.1.2.1 [#80] Exit to Wait State
If:
Package Current < Discharge Current Limit OR
Package Current > Charge Current Limit

##### 4.2.1.3 [#87] Wait State

###### 4.2.1.3.1 [#81] Exit Condition and Priorities
Priory Exits:
1) Exit to Over Current Fault
2) Exit to No Current Limitation

###### 4.2.1.3.1.1 [#82] Exit to Over Current Fault
if WaitCurrentLimitationConf seconds elapse from entering the state

###### 4.2.1.3.1.2 [#83] Exit to No Current Limitation
if:
Package Current >= Discharge Current Limit OR
Package Current <= Charge Current Limit

##### 4.2.1.4 [#88] Over Current Limitation
In this state it is necessary set:
- FaultPresent = 1
- Fault_out.OverCurrent = 1;

#### 4.2.2 [#89] Temperature Fault
During Temperature monitoring there are 3 states:
- No Temperature Fault
- High Temperature Fault
- Low Temperature Fault

##### 4.2.2.1 [#90] Init State
The initial state is No Temperature Fault.
Before to enter in this state we set FaultPresent = false

##### 4.2.2.2 [#91] No Temperature Fault State
During No Temperature Fault the following values are calculated:
- MaxCellTemp = max(Cell_Temperatures)
- MinCellTemperatues = min(Cell_Temperatures)

###### 4.2.2.2.1 [#98] Exit Condition and Priorities
Priory Exits:
1) Exit to High Temperature Fault
2) Exit to Low Temperature Fault

###### 4.2.2.2.1.1 [#99] Charger Contactor Management
if MaxCellTemp >= HighTempLimit

###### 4.2.2.2.1.2 [#100] Exit to Low Tempearture Fault
if MinCellTemp >= LowTempLimit

##### 4.2.2.3 [#93] High Tempearture Fault
In this state set:
- FaultPresent = true
- Fault_out.HighTemp = 1;

##### 4.2.2.4 [#101] Low Tempearture Fault
In this state set:
- FaultPresent = true
- Fault_out.MinTemp = 1;

#### 4.2.3 [#102] Voltage Fault
During Voltage monitoring there are 4 states:
- No Voltage Fault
- Over Voltage Fault
- Under Voltage Fault
- Sensor Voltage Fault

##### 4.2.3.1 [#103] Init State
The initial state is No Voltage Fault.
Before to enter in this state we set FaultPresent = false

##### 4.2.3.2 [#104] No Voltage Fault State
During No Voltage Fault the following values are calculated:
- SumOfVoltages = max(Cell_Voltages)
- Delta = abs(Pack Voltage - SumOfVoltages)

###### 4.2.3.2.1 [#105] Exit Condition and Priorities
Priory Exits:
1) Exit to Over Voltage Fault
2) Exit to Under Voltage Fault
3) Exit to Sensor Fault

###### 4.2.3.2.1.1 [#106] Exit to Over Voltage Fault
if MaxCellVolt >= OverCellVoltageLimit

###### 4.2.3.2.1.2 [#107] Exit to Under Voltage Fault
if MinCellVolt <= UnderCellVoltageLimit

###### 4.2.3.2.1.3 [#110] Exit to Sensor Fault
if Delta > SnsrFltThld

##### 4.2.3.3 [#108] Over Voltage Fault
In this state set:
- FaultPresent = true
- Fault_out.OverVolt = 1;

##### 4.2.3.4 [#109] Under Voltage Fault
In this state set:
- FaultPresent = true
- Fault_out.UnderVolt = 1;

##### 4.2.3.5 [#111] Sensor Fault
In this state set:
- FaultPresent = true
- Fault_out.SensorVolt = 1;

### 4.3 [#112] Charger Contactors Management
It is necessary close and open charger contactors following some steps
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
#### 4.3.1 [#113] Opening

##### 4.3.1.1 [#144] Exit Conditions to Closing
if StateRequest == Charging AND
Inverter Contactors State == Open AND
FaultPresent == False

##### 4.3.1.2 [#114] Init State
The initial state is Open Pre-Charger Contactors.
Before to enter in this state we set Fault_out.Charger = false

##### 4.3.1.3 [#117] Close Pre-Charger Contactors
In this state set Charger Command Pre-charger Contactor = true

###### 4.3.1.3.1 [#119] Exit to Open Positive Contactors
if ContactorTime seconds elapse from entering the state

##### 4.3.1.4 [#115] Open Positive Contactors
In this state set Charger Command Positive Contactor = false

###### 4.3.1.4.1 [#116] Exit to Open Pre-Charger Contactors
if ContactorTime seconds elapse from entering the state

##### 4.3.1.5 [#140] Open Open Pre-Charger Contactors
In this state set Charger Command Pre-charger Contactor = false

###### 4.3.1.5.1 [#141] Exit to Open Negative Contactors
if ContactorTime seconds elapse from entering the state

##### 4.3.1.6 [#142] Open Open Negative Contactors
In this state set Charger Command Negative Contactor = false

#### 4.3.2 [#145] Closing

##### 4.3.2.1 [#146] Exit Conditions to Opening
if StateRequest != Charging OR
FaultPresent == True

##### 4.3.2.2 [#147] Init State
The initial state is Open Pre-Charger Contactors.
Before to enter in this state we set Fault_out.Charger = false

##### 4.3.2.3 [#148] Close Negative Contactors
In this state set Charger Command Negative Contactor = true

###### 4.3.2.3.1 [#149] Exit to Close Pre-Charger Contactors
if ContactorTime seconds elapse from entering the state

##### 4.3.2.4 [#150] Close Pre-Charger Contactors
In this state set Charger Command Pre-charger Contactor = true

###### 4.3.2.4.1 [#156] Exit Conditions and priorities
Priory Exits:
1) Exit to Exit to Close Positive Contactors
2) Exit to Pre-Charger Fault

###### 4.3.2.4.1.1 [#151] Exit to Close Positive Contactors
if (VCharger/PackVoltage) >= vratio

###### 4.3.2.4.1.2 [#157] Exit to Pre-Charger Fault
if TimeoutContactor seconds elapse from entering the state

##### 4.3.2.5 [#152] Close Positive Contactors
In this state set Charger Command Positive Contactor = true

###### 4.3.2.5.1 [#153] Exit to Open Pre-Charger Contactors
if ContactorTime seconds elapse from entering the state

##### 4.3.2.6 [#154] Open Pre-Charger Contactors
In this state set Charger Command Pre-charger Contactor = false

##### 4.3.2.7 [#155] Pre-Charger Fault

### 4.4 [#158] Inverter Contactors Management
It is necessary close and open inverter contactors following some steps
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
#### 4.4.1 [#159] Opening

##### 4.4.1.1 [#160] Exit Conditions to Closing
if StateRequest == Driving AND
Charger Contactors State == Open AND
FaultPresent == False

##### 4.4.1.2 [#161] Init State
The initial state is Open Pre-Charger Contactors.
Before to enter in this state we set Fault_out.Charger = false

##### 4.4.1.3 [#162] Close Pre-Charger Contactors
In this state set Charger Command Pre-charger Contactor = true

###### 4.4.1.3.1 [#163] Exit to Open Positive Contactors
if ContactorTime seconds elapse from entering the state

##### 4.4.1.4 [#164] Open Positive Contactors
In this state set Charger Command Positive Contactor = false

###### 4.4.1.4.1 [#165] Exit to Open Pre-Charger Contactors
if ContactorTime seconds elapse from entering the state

##### 4.4.1.5 [#166] Open Open Pre-Charger Contactors
In this state set Charger Command Pre-charger Contactor = false

###### 4.4.1.5.1 [#167] Exit to Open Negative Contactors
if ContactorTime seconds elapse from entering the state

##### 4.4.1.6 [#168] Open Open Negative Contactors
In this state set Charger Command Negative Contactor = false

#### 4.4.2 [#169] Closing

##### 4.4.2.1 [#170] Exit Conditions to Opening
if StateRequest != Driving OR
FaultPresent == True

##### 4.4.2.2 [#171] Init State
The initial state is Open Pre-Charger Contactors.
Before to enter in this state we set Fault_out.Charger = false

##### 4.4.2.3 [#172] Close Negative Contactors
In this state set Charger Command Negative Contactor = true

###### 4.4.2.3.1 [#173] Exit to Close Pre-Charger Contactors
if ContactorTime seconds elapse from entering the state

##### 4.4.2.4 [#174] Close Pre-Charger Contactors
In this state set Charger Command Pre-charger Contactor = true

###### 4.4.2.4.1 [#175] Exit Conditions and priorities
Priory Exits:
1) Exit to Exit to Close Positive Contactors
2) Exit to Pre-Charger Fault

###### 4.4.2.4.1.1 [#176] Exit to Close Positive Contactors
if (VCharger/PackVoltage) >= vratio

###### 4.4.2.4.1.2 [#177] Exit to Pre-Charger Fault
if TimeoutContactor seconds elapse from entering the state

##### 4.4.2.5 [#178] Close Positive Contactors
In this state set Charger Command Positive Contactor = true

###### 4.4.2.5.1 [#179] Exit to Open Pre-Charger Contactors
if ContactorTime seconds elapse from entering the state

##### 4.4.2.6 [#180] Open Pre-Charger Contactors
In this state set Charger Command Pre-charger Contactor = false

##### 4.4.2.7 [#181] Pre-Charger Fault