test file "State_Machine_Test"
  coverage: Decision, MCDC, Condition

suite "State_Machine"

  case "State_Machine_Harness_Dashboard" [simulation]
    model State_Machine, harness State_Machine_Harness_Dashboard

  suite "State_Machine_Harness_SignalBuilder"

    case "BMS_Charging_CC_CV" [simulation]
      model State_Machine, harness State_Machine_Harness_SignalBuilder, stop time 85
      signal scenario: BMS_Charging_CC_CV

    case "BMS_Driving_Fault1" [simulation]
      model State_Machine, harness State_Machine_Harness_SignalBuilder, stop time 40
      signal scenario: BMS_Driving_Fault1

    case "BMS_Driving_Fault2" [simulation]
      model State_Machine, harness State_Machine_Harness_SignalBuilder, stop time 30
      signal scenario: BMS_Driving_Fault2

    case "Fault_Current1" [simulation]
      model State_Machine, harness State_Machine_Harness_SignalBuilder, stop time 5
      signal scenario: Fault_Current1

    case "Fault_Current2" [simulation]
      model State_Machine, harness State_Machine_Harness_SignalBuilder, stop time 2
      signal scenario: Fault_Current2

    case "Fault_PreChargerSwitches" [simulation]
      model State_Machine, harness State_Machine_Harness_SignalBuilder, stop time 30
      signal scenario: Fault_PreChargerSwitches

    case "Fault_Temp1" [simulation]
      model State_Machine, harness State_Machine_Harness_SignalBuilder, stop time 2
      signal scenario: Fault_Temp1

    case "Fault_Temp2" [simulation]
      model State_Machine, harness State_Machine_Harness_SignalBuilder, stop time 2
      signal scenario: Fault_Temp2

    case "Fault_Voltage1" [simulation]
      model State_Machine, harness State_Machine_Harness_SignalBuilder, stop time 2
      signal scenario: Fault_Voltage1

    case "Fault_Voltage2" [simulation]
      model State_Machine, harness State_Machine_Harness_SignalBuilder, stop time 2
      signal scenario: Fault_Voltage2

    case "Fault_Voltage3" [simulation]
      model State_Machine, harness State_Machine_Harness_SignalBuilder
      signal scenario: Fault_Voltage3 (State_Machine_Harness_SignalBuilder/Signal Builder1)