test file "State_Machine_Test_DV"
  coverage: Decision, MCDC, Condition

suite "New Test Suite 1"

  case "New Test Case 1" [simulation]
    model State_Machine, harness State_Machine_Harness_DV
    signal scenario: Test Case 1 (State_Machine_Harness1/Harness Inputs)
    iterations:
      Test Case 1: SignalBuilderGroup "Test Case 1"
      Test Case 2: SignalBuilderGroup "Test Case 2"
      Test Case 3: SignalBuilderGroup "Test Case 3"
      Test Case 4: SignalBuilderGroup "Test Case 4"
      Test Case 5: SignalBuilderGroup "Test Case 5"
      Test Case 6: SignalBuilderGroup "Test Case 6"
      Test Case 7: SignalBuilderGroup "Test Case 7"
      Test Case 8: SignalBuilderGroup "Test Case 8"
      Test Case 9: SignalBuilderGroup "Test Case 9"
      Test Case 10: SignalBuilderGroup "Test Case 10"
      Test Case 11: SignalBuilderGroup "Test Case 11"
      Test Case 12: SignalBuilderGroup "Test Case 12"
      Test Case 13: SignalBuilderGroup "Test Case 13"