test file "State_Machine_Test_Equivalence"
  coverage: Decision, MCDC, Condition

suite "State_Machine"

  suite "State_Machine_Harness_SignalBuilder"

    case "BMS_Charging_CC_CV" [equivalence]
      simulation 1:
        model State_Machine, harness State_Machine_Harness_SignalBuilder, mode Normal, stop time 85
        signal scenario: BMS_Charging_CC_CV
      simulation 2:
        model State_Machine, harness State_Machine_Harness_SignalBuilder, mode Software-in-the-Loop (SIL), stop time 85
        signal scenario: BMS_Charging_CC_CV

    case "BMS_Driving_Fault1" [equivalence]
      simulation 1:
        model State_Machine, harness State_Machine_Harness_SignalBuilder, mode Normal, stop time 40
        signal scenario: BMS_Driving_Fault1
      simulation 2:
        model State_Machine, harness State_Machine_Harness_SignalBuilder, mode Software-in-the-Loop (SIL), stop time 40
        signal scenario: BMS_Driving_Fault1

    case "BMS_Driving_Fault2" [equivalence]
      simulation 1:
        model State_Machine, harness State_Machine_Harness_SignalBuilder, mode Normal, stop time 30
        signal scenario: BMS_Driving_Fault2
      simulation 2:
        model State_Machine, harness State_Machine_Harness_SignalBuilder, mode Software-in-the-Loop (SIL), stop time 30
        signal scenario: BMS_Driving_Fault2

    case "Fault_Current1" [equivalence]
      simulation 1:
        model State_Machine, harness State_Machine_Harness_SignalBuilder, mode Normal, stop time 5
        signal scenario: Fault_Current1
      simulation 2:
        model State_Machine, harness State_Machine_Harness_SignalBuilder, mode Software-in-the-Loop (SIL), stop time 5
        signal scenario: Fault_Current1

    case "Fault_Current2" [equivalence]
      simulation 1:
        model State_Machine, harness State_Machine_Harness_SignalBuilder, mode Normal, stop time 2
        signal scenario: Fault_Current2
      simulation 2:
        model State_Machine, harness State_Machine_Harness_SignalBuilder, mode Software-in-the-Loop (SIL), stop time 2
        signal scenario: Fault_Current2

    case "Fault_PreChargerSwitches" [equivalence]
      simulation 1:
        model State_Machine, harness State_Machine_Harness_SignalBuilder, mode Normal, stop time 30
        signal scenario: Fault_PreChargerSwitches
      simulation 2:
        model State_Machine, harness State_Machine_Harness_SignalBuilder, mode Software-in-the-Loop (SIL), stop time 30
        signal scenario: Fault_PreChargerSwitches

    case "Fault_Temp1" [equivalence]
      simulation 1:
        model State_Machine, harness State_Machine_Harness_SignalBuilder, mode Normal, stop time 2
        signal scenario: Fault_Temp1
      simulation 2:
        model State_Machine, harness State_Machine_Harness_SignalBuilder, mode Software-in-the-Loop (SIL), stop time 2
        signal scenario: Fault_Temp1

    case "Fault_Temp2" [equivalence]
      simulation 1:
        model State_Machine, harness State_Machine_Harness_SignalBuilder, mode Normal, stop time 2
        signal scenario: Fault_Temp2
      simulation 2:
        model State_Machine, harness State_Machine_Harness_SignalBuilder, mode Software-in-the-Loop (SIL), stop time 2
        signal scenario: Fault_Temp2

    case "Fault_Voltage1" [equivalence]
      simulation 1:
        model State_Machine, harness State_Machine_Harness_SignalBuilder, mode Normal, stop time 2
        signal scenario: Fault_Voltage1
      simulation 2:
        model State_Machine, harness State_Machine_Harness_SignalBuilder, mode Software-in-the-Loop (SIL), stop time 2
        signal scenario: Fault_Voltage1

    case "Fault_Voltage2" [equivalence]
      simulation 1:
        model State_Machine, harness State_Machine_Harness_SignalBuilder, mode Normal, stop time 2
        signal scenario: Fault_Voltage2
      simulation 2:
        model State_Machine, harness State_Machine_Harness_SignalBuilder, mode Software-in-the-Loop (SIL), stop time 2
        signal scenario: Fault_Voltage2

    case "Fault_Voltage3" [equivalence]
      simulation 1:
        model State_Machine, harness State_Machine_Harness_SignalBuilder, mode Normal
        signal scenario: Fault_Voltage3 (State_Machine_Harness_SignalBuilder/Signal Builder1)
      simulation 2:
        model State_Machine, harness State_Machine_Harness_SignalBuilder, mode Software-in-the-Loop (SIL)
        signal scenario: Fault_Voltage3 (State_Machine_Harness_SignalBuilder/Signal Builder1)